# Grasshopper definition 10 Dome experiment.ghx (Grasshopper 1.0.8)
# plug-ins: Kangaroo2 Components

pt = Point(<point referenced from the Rhino model>)
number_slider = Slider(4216, range=3000..5000)
number_slider_2 = Slider(10, range=5..20)
number_slider_3 = Slider(10, range=5..20)
xy = XYPlane(Origin=pt)
genes = GenePool(Decimals=0, Maximum=5000, Minimum=0, Value=[5000, 4186, 1516, 3815, 2542])
Z = UnitZ(Factor="-1")
move = Move(Geometry=xy, Motion=Z)  # -> Geometry, Transform
pt_2 = Point(<point referenced from the Rhino model>)
pt_3 = Point(<point referenced from the Rhino model>)
pt_4 = Point(<point referenced from the Rhino model>)
pt_5 = Point(<point referenced from the Rhino model>)
pt_6 = Point(<point referenced from the Rhino model>)
msphere = MeshSphere(Base=xy, Radius=number_slider, UCount=number_slider_2, VCount=number_slider_3)
crv = Curve([<curve referenced from the Rhino model> x5])
xy_2 = XYPlane(Origin=pt_2)
msplit = MeshSplitPlane(Mesh=msphere, Plane=move.Geometry)  # -> Above, Below
xy_3 = XYPlane(Origin=pt_4)
xy_4 = XYPlane(Origin=pt_6)
xy_5 = XYPlane(Origin=pt_5)
xy_6 = XYPlane(Origin=pt_3)
number_slider_4 = Slider(50, range=50..100)
xy_7 = XYPlane(Origin=Point(0, 0, 0))
medges = MeshEdges(Mesh=msplit.Above)  # -> NakedEdges, InteriorEdges, NonManifoldEdges
sphere = Sphere(Base=xy_2, Radius=Slider(4000, range=500..5000))
sphere_2 = Sphere(Base=xy_3, Radius=Slider(1500, range=500..5000))
sphere_3 = Sphere(Base=xy_4, Radius=Slider(1000, range=500..5000))
sphere_4 = Sphere(Base=xy_5, Radius=Slider(2500, range=500..5000))
sphere_5 = Sphere(Base=xy_6, Radius=Slider(3000, range=500..5000))
sphere_6 = Sphere(Base=xy_7, Radius=1)
construct_point = ConstructPoint(XCoordinate=0, YCoordinate=0, ZCoordinate=Slider(-1200, range=-1200..2000))
pipe = Pipe(Curve=medges.InteriorEdges, Radius=number_slider_4, Caps=0)
addition = Addition(A=number_slider, B=number_slider_4)
xy_plane = XYPlane(Origin=construct_point)
panel = Panel("C:\Users\xlydi\OneDrive\Documents\GitHub\Archipunk-Lydia-and-Freya\10 art.png")
cir = Circle(Plane=xy, Radius=addition)
sph = Sphere(Base=xy, Radius=addition)
msphere_2 = MeshSphere(Base=xy, Radius=addition, UCount=number_slider_2, VCount=number_slider_3)
solid_union = SolidUnion(Breps=[sphere, sphere_5, sphere_4, sphere_3, sphere_2])
brep_plane = BrepPlane(Plane=xy_plane)  # -> Curves, Points
msplit_2 = MeshSplitPlane(Mesh=msphere_2, Plane=move.Geometry)  # -> Above, Below
srfsplit = SurfaceSplit(Surface=sph, Curves=cir)
split_brep = SplitBrep(Brep=solid_union)
number_slider_5 = Slider(100, range=10..200)
crv_2 = Curve(<curve referenced from the Rhino model>)
item = ListItem(List=srfsplit, Index="0", Wrap=True)
path = FilePath(panel)
faceb = FaceBoundaries(Mesh=msphere_2)
img = ImportImage(File=path, Rectangle=crv_2, XSamples=number_slider_5, YSamples=number_slider_5)

# ---- group: gradually increase this until circles are packed
number_slider_6 = Slider(1.258, range=0..20)

# ----
demesh = DeconstructMesh(Mesh=msplit_2.Above)  # -> Vertices, Faces, Colours, Normals
list_item = ListItem(List=split_brep, Index="0", Wrap=True)
panel_2 = Panel(demesh.Faces)
N = Count(1700)
mesh = Mesh(img)
triremesh = TriRemesh(Geometry=list_item, Length=Slider(29, range=0..500), Iterations=25)  # -> Triangulation, Dual, Creases
item_2 = ListItem(List=demesh.Faces, Index="0", Wrap=True)
sdivide = DivideSurface(Surface=item, UCount=number_slider_5, VCount=number_slider_5)  # -> Points, Normals, Parameters
pop2d = Populate2D(Region=crv_2, Count=N, Seed=1)
multiplication = Multiplication(A=Slider(10.792, range=1..100), B=number_slider_6)
multiplication_2 = Multiplication(A=Slider(72.317, range=1..100), B=number_slider_6)
list_item_2 = ListItem(Index=Slider(5, range=0..10), Wrap=True)
qrmesh = QuadRemesh(Mesh=triremesh.Triangulation, Settings={aqc=True, as=50, dhe=True, gci=0, null=False, pme=0, sa=0, tqc=2000})
mesh_2 = Mesh(triremesh.Triangulation)
imgcircles = ImageCircles(Points=pop2d, Mesh=mesh, Min=multiplication, Max=multiplication_2, Curves=crv_2, Strength=1)
volume = Volume(Geometry=list_item_2)  # -> Volume, Centroid
face_boundaries = FaceBoundaries(Mesh=qrmesh)
mesh_3 = MeshBrep(
    Brep=item,
    Settings={GridMaxCount=0, GridMinCount=16, JaggedSeams=False, MaxEdgeLength=0, MinEdgeLength=0.0001, MinTolerance=0, Refine=True, RefineAngle=0, RelativeTolerance=0.65, SimplePlanes=True, Tolerance=0})
solver = Solver(GoalObjects=imgcircles, Reset=Button(), Threshold=1e-15, Tolerance=0.01, On=Toggle(True))  # -> I, V, O
number_slider_7 = Slider(0.92, range=0..1)
number_slider_8 = Slider(0.58, range=0..1)
polygon_center = PolygonCenter(Polyline=face_boundaries)  # -> CenterV, CenterE, CenterA
Z_2 = UnitZ(Factor=1)
distance = Distance(PointA=polygon_center.CenterV, PointB=volume.Centroid)
cir_2 = Circle(Plane=solver.V, Radius=solver.O)
neg = Negative(Value=Z_2)
area = Area(Geometry=cir_2)  # -> Area, Centroid
meshray = MeshRay(Mesh=mesh_3, Point=area.Centroid, Direction=neg)  # -> Point, Hit
srf_cp = SurfaceClosestPoint(Point=meshray.Point, Surface=item)  # -> Point, UVPoint, Distance
construct_domain = ConstructDomain(DomainStart=number_slider_7, DomainEnd=number_slider_8)
bounds = Bounds(Numbers=distance)
evalsrf = EvaluateSurface(Surface=item, Point=srf_cp.UVPoint)  # -> Point, Normal, UDirection, VDirection, Frame
xy_8 = XYPlane(Origin=Point(0, 0, 0))
remap_numbers = RemapNumbers(Value=distance, Source=bounds, Target=construct_domain)  # -> Mapped, Clipped
pl_origin = PlaneOrigin(Base=xy_8, Origin=area.Centroid)
orient = Orient(Geometry=cir_2, Source=pl_origin, Target=evalsrf.Frame)  # -> Geometry, Transform
scale = Scale(Geometry=face_boundaries, Center=polygon_center.CenterV, Factor=remap_numbers.Mapped)  # -> Geometry, Transform
pull = PullCurve(Curve=orient.Geometry, Surface=item)
gradient = Gradient(
    LowerLimit=number_slider_7,
    UpperLimit=number_slider_8,
    Parameter=remap_numbers.Mapped,
    stops=[0.15: RGB(255, 130, 160), 0.85: RGB(220, 0, 40)])
ruled_surface = RuledSurface(CurveA=face_boundaries, CurveB=scale.Geometry)
custom_preview = CustomPreview(Geometry=ruled_surface, Material=gradient)
