# Grasshopper definition 11 Structure.ghx (Grasshopper 1.0.8)
# plug-ins: Pufferfish, Kangaroo2 Components

number_slider = Slider(4000, range=500..5000)
number_slider_2 = Slider(1000, range=500..5000)
number_slider_3 = Slider(2500, range=500..5000)
number_slider_4 = Slider(3000, range=500..5000)
number_slider_5 = Slider(1500, range=500..5000)
number_slider_6 = Slider(1000, range=500..5000)
number_slider_7 = Slider(2500, range=500..5000)
number_slider_8 = Slider(3000, range=500..5000)
pt = Point(<point referenced from the Rhino model>)
pt_2 = Point(<point referenced from the Rhino model>)
pt_3 = Point(<point referenced from the Rhino model>)
pt_4 = Point(<point referenced from the Rhino model>)
pt_5 = Point(<point referenced from the Rhino model>)
pt_6 = Point(<point referenced from the Rhino model>)
pt_7 = Point(<point referenced from the Rhino model>)
pt_8 = Point(<point referenced from the Rhino model>)
xy = XYPlane(Origin=pt)
xy_2 = XYPlane(Origin=pt_2)
xy_3 = XYPlane(Origin=pt_5)
xy_4 = XYPlane(Origin=pt_4)
xy_5 = XYPlane(Origin=pt_3)
xy_6 = XYPlane(Origin=pt_8)
xy_7 = XYPlane(Origin=pt_7)
xy_8 = XYPlane(Origin=pt_6)
sphere = Sphere(Base=xy, Radius=number_slider)
sphere_2 = Sphere(Base=xy_6, Radius=number_slider_6)
sphere_3 = Sphere(Base=xy_7, Radius=number_slider_7)
sphere_4 = Sphere(Base=xy_2, Radius=number_slider_5)
sphere_5 = Sphere(Base=xy_8, Radius=number_slider_8)
sphere_6 = Sphere(Base=xy_3, Radius=number_slider_2)
sphere_7 = Sphere(Base=xy_4, Radius=number_slider_3)
sphere_8 = Sphere(Base=xy_5, Radius=number_slider_4)
msphere = MeshSphere(Base=xy, Radius=number_slider, UCount=10, VCount=20)
msphere_2 = MeshSphere(Base=xy_5, Radius=number_slider_4, UCount=10, VCount=20)
msphere_3 = MeshSphere(Base=xy_4, Radius=number_slider_3, UCount=10, VCount=20)
msphere_4 = MeshSphere(Base=xy_3, Radius=number_slider_2, UCount=10, VCount=20)
msphere_5 = MeshSphere(Base=xy_2, Radius=number_slider_5, UCount=10, VCount=20)
msphere_6 = MeshSphere(Base=xy_8, Radius=number_slider_8, UCount=10, VCount=20)
msphere_7 = MeshSphere(Base=xy_7, Radius=number_slider_7, UCount=10, VCount=20)
msphere_8 = MeshSphere(Base=xy_6, Radius=number_slider_6, UCount=10, VCount=20)
graft = GraftTree(Tree=[pt, pt_3, pt_4, pt_5, pt_2], IncludeEmptyLists=True, IncludeNullItems=True)
graft_2 = GraftTree(Tree=[xy_8, xy_7, xy_6], IncludeEmptyLists=True, IncludeNullItems=True)
graft_3 = GraftTree(Tree=[number_slider_8, number_slider_7, number_slider_6], IncludeEmptyLists=True, IncludeNullItems=True)
graft_4 = GraftTree(Tree=[xy, xy_5, xy_4, xy_3, xy_2], IncludeEmptyLists=True, IncludeNullItems=True)
graft_5 = GraftTree(
    Tree=[number_slider, number_slider_4, number_slider_3, number_slider_2, number_slider_5],
    IncludeEmptyLists=True,
    IncludeNullItems=True)
munion = MeshUnion(Meshes=[msphere_6, msphere_7, msphere_8])
munion_2 = MeshUnion(Meshes=[msphere, msphere_2, msphere_3, msphere_4, msphere_5])
cir = Circle(Plane=graft_2, Radius=graft_3)
cir_2 = Circle(Plane=graft_4, Radius=graft_5)
solid_union = SolidUnion(Breps=[sphere_5, sphere_3, sphere_2])
Y = UnitY(Factor=1)
solid_union_2 = SolidUnion(Breps=[sphere, sphere_8, sphere_7, sphere_6, sphere_4])
runion = RegionUnion(Curves=flatten(cir_2))
runion_2 = RegionUnion(Curves=flatten(cir))
rot3d = Rotate3D(Geometry=cir_2, Angle=degrees("90"), Center=graft, Axis=Y)  # -> Geometry, Transform
msplit = MeshSplit(Mesh=munion_2, Splitters=munion)
sdiff = SolidDifference(BrepsA=solid_union_2, BrepsB=solid_union)
split_brep = SplitBrep(Brep=solid_union_2, Cutter=runion)
list_item = ListItem(List=msplit, Index="0", Wrap=True)
panel = Panel("""0
1
2
3
4""")
debrep = DeconstructBrep(Brep=sdiff)  # -> Faces, Edges, Vertices
msplit_2 = MeshSplitPlane(Mesh=list_item, Plane=xy)  # -> Above, Below
list_item_2 = ListItem(List=split_brep, Index="0", Wrap=True)
rdiff = RegionDifference(CurvesA=runion, CurvesB=runion_2)
list_item_3 = ListItem(List=debrep.Faces, Index=panel, Wrap=True)
list_item_4 = ListItem(List=msplit_2.Above, Index="0", Wrap=True)
join = BrepJoin(Breps=list_item_3)  # -> Breps, Closed
split_brep_2 = SplitBrep(Brep=join.Breps, Cutter=rdiff)
medges = MeshEdges(Mesh=list_item_4)  # -> NakedEdges, InteriorEdges, NonManifoldEdges
list_item_5 = ListItem(List=split_brep_2, Index="0", Wrap=True)
qrsettings = QuadRemeshSettings(TargetCount=1000, AdaptiveSize=0, AdaptiveCount=False, HardEdges=False, SeamEdges=0, Symmetry=0, GuideCurves=0)
number_slider_9 = Slider(20, range=10..100)
qrmesh = QuadRemesh(Mesh=list_item_5, Settings=qrsettings)
pipe = Pipe(Curve=[medges.NakedEdges, medges.InteriorEdges], Radius=number_slider_9, Caps=0)
medges_2 = MeshEdges(Mesh=qrmesh)  # -> NakedEdges, InteriorEdges, NonManifoldEdges
pipe_2 = Pipe(Curve=[medges_2.NakedEdges, medges_2.InteriorEdges], Radius=Slider(20, range=10..100), Caps=0)
addition = Addition(A=number_slider, B=number_slider_9)
panel_2 = Panel("C:\Users\xlydi\OneDrive\Documents\GitHub\Archipunk-Lydia-and-Freya\10 art.png")
cir_3 = Circle(Plane=xy, Radius=addition)
sph = Sphere(Base=xy, Radius=addition)
offmsh = OffsetMesh(Mesh=list_item_4, Distance=number_slider_9, BothSides=0, CreateSolid=invert(True))
srfsplit = SurfaceSplit(Surface=sph, Curves=cir_3)
crv = Curve(<curve referenced from the Rhino model>)
path = FilePath(panel_2)
item = ListItem(List=srfsplit, Index="0", Wrap=True)
img = ImportImage(File=path, Rectangle=crv)

# ---- group: gradually increase this until circles are packed
number_slider_10 = Slider(1.305, range=0..20)

# ----
N = Count(1700)
mesh = Mesh(img)
pop2d = Populate2D(Region=crv, Count=N, Seed=1)
multiplication = Multiplication(A=Slider(15.185, range=1..100), B=number_slider_10)
multiplication_2 = Multiplication(A=Slider(72.317, range=1..100), B=number_slider_10)
imgcircles = ImageCircles(Points=pop2d, Mesh=mesh, Min=multiplication, Max=multiplication_2, Curves=crv, Strength=1)
solver = Solver(GoalObjects=imgcircles, Reset=Button(), Threshold=1e-15, Tolerance=0.01, On=Toggle(True))  # -> I, V, O
Z = UnitZ(Factor=1)
cir_4 = Circle(Plane=solver.V, Radius=solver.O)
neg = Negative(Value=Z)
msh2psrf = MeshToPolysurface(Mesh=offmsh, Triangles=False, FaceMerge=False)
area = Area(Geometry=cir_4)  # -> Area, Centroid
meshray = MeshRay(Mesh=item, Point=area.Centroid, Direction=neg)  # -> Point, Hit
srf_cp = SurfaceClosestPoint(Point=meshray.Point, Surface=item)  # -> Point, UVPoint, Distance
evalsrf = EvaluateSurface(Surface=item, Point=srf_cp.UVPoint)  # -> Point, Normal, UDirection, VDirection, Frame
xy_9 = XYPlane(Origin=Point(0, 0, 0))
pl_origin = PlaneOrigin(Base=xy_9, Origin=area.Centroid)
orient = Orient(Geometry=cir_4, Source=pl_origin, Target=evalsrf.Frame)  # -> Geometry, Transform
pull = PullCurve(Curve=orient.Geometry, Surface=msh2psrf)
amp = Amplitude(Vector=evalsrf.Normal, Amplitude=Slider(100, range=0..100))
neg_2 = Negative(Value=amp)
merge = Merge(Data1=graft(amp), Data2=graft(neg_2))
extr = Extrude(Base=graft(orient.Geometry), Direction=merge)
join_2 = BrepJoin(Breps=extr)  # -> flatten(Breps), Closed
split = SplitList(List=flatten(join_2.Breps), Index=Slider(180, range=0..1000))  # -> ListA, ListB
splitmul = SplitBrepMultiple(Brep=msh2psrf)
geo = Geometry(split.ListA)
item_2 = ListItem(List=splitmul, Index="2", Wrap=True)
panel_3 = Panel(splitmul)
