# Grasshopper definition Week 5 - Clock Face.ghx (Grasshopper 1.0.8)

radius = Slider(10, range=0..10)
number_slider = Slider(5000, range=300..5000)
number_slider_2 = Slider(6, range=0..100)
division = Division(A=number_slider, B=Slider(1.21, range=0..10))
pi = Pi(Factor="2")
modulus = Modulus(A=number_slider_2, B=Slider(9, range=0..100))
circle = Circle(Plane=PlaneXY(0, 0, 0), Radius=number_slider)
construct_point = ConstructPoint(XCoordinate="0", YCoordinate="0", ZCoordinate="0")
circle_2 = Circle(Plane=PlaneXY(0, 0, 0), Radius=division)
addition = Addition(A=number_slider_2, B=modulus)
integer = Integer(addition)
division_2 = Division(A=pi, B="60")
divide_curve = DivideCurve(Curve=circle, Count=addition, Kinks=False)  # -> Points, Tangents, Parameters
degrees = Degrees(Radians=division_2)
pi_2 = Pi(Factor=2)
division_3 = Division(A=pi_2, B=addition)
trigger = Trigger(Interval=1000, TimerInterval=1000, Target=data_recorder)
multiplication = Multiplication(A="60", B="12")
dispatch = Dispatch(List=divide_curve.Points, DispatchPattern=[True, False])  # -> ListA, ListB
multiplication_2 = Multiplication(A=degrees, B=Slider(3102, range=0..4000))
data_recorder = DataRecorder(degrees, DataLimit=-10, RecordData=True)  # disabled
division_4 = Division(A=data_recorder, B="60")
division_5 = Division(A=data_recorder, B=multiplication)
mass_addition = MassAddition(Input=division_4)  # -> Result, PartialResults
mass_addition_2 = MassAddition(Input=division_5)  # -> Result, PartialResults
line = Line(StartPoint=dispatch.ListA, EndPoint=dispatch.ListB)
mass_addition_3 = MassAddition(Input=data_recorder)  # -> Result, PartialResults
multiplication_3 = Multiplication(A=mass_addition.Result, B="-1")
multiplication_4 = Multiplication(A=mass_addition_2.Result, B="-1")
unit_z = UnitZ(Factor=1)
pi_3 = Pi(Factor=-0.5)
vector = Vector(line)
concatenate = Concatenate(FragmentA=mass_addition_3.Result, FragmentB="deg.")
multiplication_5 = Multiplication(A=mass_addition_3.Result, B="-1")
rotate = Rotate(Vector=vector, Axis=unit_z, Angle=pi_3)
panel = Panel(concatenate)
amplitude = Amplitude(Vector=rotate, Amplitude=Slider(449, range=50..1000))
point_polar = PointPolar(
    BasePlane=construct_point,
    XYAngle=expr("x+90", degrees(multiplication_5)),
    ZAngle=0,
    Offset=Slider(3408, range=300..5000))
point_polar_2 = PointPolar(
    BasePlane=construct_point,
    XYAngle=expr("x+90", degrees(multiplication_3)),
    ZAngle=0,
    Offset=Slider(2768, range=300..5000))
point_polar_3 = PointPolar(
    BasePlane=construct_point,
    XYAngle=expr("x+90", degrees(multiplication_4)),
    ZAngle=0,
    Offset=Slider(1824, range=300..5000))
panel_2 = Panel(mass_addition_3.Result)
panel_3 = Panel("""35
-35""")
move = Move(Geometry=line, Motion=amplitude)  # -> Geometry, Transform
line_2 = Line(StartPoint=construct_point, EndPoint=point_polar)
line_3 = Line(StartPoint=construct_point, EndPoint=point_polar_2)
curve = Curve(line)
line_4 = Line(StartPoint=construct_point, EndPoint=point_polar_3)
offset = OffsetCurve(Curve=line_2, Distance=panel_3, Corners=1)  # -> flatten(Curve)
cir = Circle(Plane=construct_point, Radius=Slider(150, range=50..1000))
evaluate_length = EvaluateLength(Curve=move.Geometry, Length=0.5, Normalized=True)  # -> Point, Tangent, Parameter
list_length = ListLength(List=line_2)
number_slider_3 = Slider(0.81, range=0..1)
evaluate_length_2 = EvaluateLength(Curve=curve, Length=0.5, Normalized=True)  # -> Point, Tangent, Parameter
loft = Loft(Curves=offset, Options={Adjust=False, Closed=False, LoftEnds=0, LoftSimp=0, LoftType=0, Rebuild=10, Refit=0.01})
multiplication_6 = Multiplication(A=list_length, B=Slider(4485, range=1000..5000))
runion = RegionUnion(Curves=[cir, loft])
midpt = CurveMiddle(Curve=line_3)
pframe = PerpFrame(Curve=line_3, Parameter="0.5")
boundary = BoundarySurfaces(Edges=runion)
midpt_2 = CurveMiddle(Curve=line_4)
pframe_2 = PerpFrame(Curve=line_4, Parameter="0.5")
deplane = DeconstructPlane(Plane=pframe)  # -> Origin, XAxis, YAxis, ZAxis
circle_3 = Circle(Plane=construct_point, Radius=multiplication_6)
deplane_2 = DeconstructPlane(Plane=pframe_2)  # -> Origin, XAxis, YAxis, ZAxis
amp = Amplitude(Vector=deplane.YAxis, Amplitude=Slider(150, range=50..1000))
division_6 = Division(A="1", B=number_slider_3)
amp_2 = Amplitude(Vector=deplane_2.YAxis, Amplitude=Slider(150, range=50..1000))
scale = Scale(Geometry=move.Geometry, Center=evaluate_length.Point, Factor=number_slider_3)  # -> Geometry, Transform
scale_2 = Scale(Geometry=curve, Center=evaluate_length_2.Point, Factor=division_6)  # -> Geometry, Transform
move_2 = Move(Geometry=midpt, Motion=amp)  # -> Geometry, Transform
offset_2 = OffsetCurve(Curve=circle_3, Distance=Slider(0.475, range=0..1), Corners=1)
move_3 = Move(Geometry=midpt_2, Motion=amp_2)  # -> Geometry, Transform
divide_curve_2 = DivideCurve(Curve=offset_2, Count=Slider(12, range=0..100), Kinks=False)  # -> Points, Tangents, Parameters
arc = Arc3Pt(PointA=construct_point, PointB=move_2.Geometry, PointC=point_polar_2)  # -> Arc, Plane, Radius
arc_2 = Arc3Pt(PointA=construct_point, PointB=move_3.Geometry, PointC=point_polar_3)  # -> Arc, Plane, Radius
mirror = MirrorCurve(Geometry=arc.Arc, Curve=line_3, Tangent=True)
shift_list = ShiftList(List=scale_2.Geometry, Shift=1, Wrap=True)
end_points = EndPoints(Curve=scale_2.Geometry)  # -> Start, End
end_points_2 = EndPoints(Curve=scale.Geometry)  # -> Start, End
shatter = Shatter(Curve=circle_3, Parameters=divide_curve_2.Parameters)
mirror_2 = MirrorCurve(Geometry=arc_2.Arc, Curve=line_4, Tangent=True)
boundary_2 = BoundarySurfaces(Edges=[mirror, arc.Arc])
panel_4 = Panel(divide_curve_2.Parameters)
end_points_3 = EndPoints(Curve=shift_list)  # -> Start, End
boundary_3 = BoundarySurfaces(Edges=[mirror_2, arc_2.Arc])
line_5 = Line(StartPoint=end_points_2.Start, EndPoint=end_points.Start)
line_6 = Line(StartPoint=end_points_2.End, EndPoint=end_points.End)
divide_curve_3 = DivideCurve(Curve=shatter, Count="5", Kinks=False)  # -> Points, Tangents, Parameters
shatter_2 = Shatter(Curve=circle_3, Parameters=flatten(divide_curve_3.Parameters))
list_item = ListItem(List=graft(shatter_2), Index=0, Wrap=True)
line_7 = Line(StartPoint=end_points.End, EndPoint=end_points_3.Start)
panel_5 = Panel("""false
true
true
true
true""")
divide_curve_4 = DivideCurve(Curve=list_item, Count="60", Kinks=False)  # -> Points, Tangents, Parameters
Z = UnitZ(Factor=Slider(70, range=50..150))
shift_list_2 = ShiftList(List=reverse(divide_curve_2.Points), Shift="-3", Wrap=True)
dispatch_2 = Dispatch(List=divide_curve_3.Points, DispatchPattern=panel_5)  # -> ListA, ListB
scale_3 = Scale(Geometry=shift_list_2, Center=construct_point, Factor=Slider(0.82, range=0..10))  # -> Geometry, Transform
construct_domain = ConstructDomain(DomainStart="1", DomainEnd="12")
merge = Merge(Data1=scale.Geometry, Data2=line_5, Data3=line_6, Data4=line_7)  # -> flatten(Result)
extr = Extrude(Base=[boundary, boundary_2, boundary_3], Direction=Z)
number = Number(division_3)
join_curves = JoinCurves(Curves=merge, Preserve=False)
range = Range(Domain=construct_domain, Steps=expr("x-1", "12"))
division_7 = Division(A=number, B=2)
point = Point(dispatch_2.ListB)
curve_2 = Curve(circle_2)
point_2 = Point(dispatch_2.ListA)
text_tag_3d = TextTag3D(Location=shift_list_2, Text=range, Size=Slider(0.6, range=0..10), Justification=5)
move_4 = Move(Geometry=curve_2, Motion=Vector(0, 0, 10))  # -> Geometry, Transform
scale_4 = Scale(Geometry=point_2, Center=construct_point, Factor=Slider(0.92, range=0..1))  # -> Geometry, Transform
scale_5 = Scale(Geometry=point, Center=construct_point, Factor=Slider(0.922, range=0..1))  # -> Geometry, Transform
rotate_2 = Rotate(Geometry=join_curves, Angle=division_7, Plane=PlaneXY(0, 0, 0))  # -> Geometry, Transform
line_8 = Line(StartPoint=point_2, EndPoint=scale_4.Geometry)
line_9 = Line(StartPoint=point, EndPoint=scale_5.Geometry)
number_2 = Number(Slider(60, range=0..100))
radians = Radians(Degrees=number_2)
rotate_3 = Rotate(Geometry=rotate_2.Geometry, Angle=radians, Plane=PlaneXY(0, 0, 0))  # -> Geometry, Transform
number_slider_4 = Slider(150, range=150..300)
curve_3 = Curve(rotate_3.Geometry)
area = Area(Geometry=curve_3)  # -> Area, Centroid
Z_2 = UnitZ(Factor=number_slider_4)
boundary_4 = BoundarySurfaces(Edges=circle_2)
boundary_5 = BoundarySurfaces(Edges=rotate_3.Geometry)
number_slider_5 = Slider(40, range=5..100)
subtraction = Subtraction(A=number_slider_4, B=number_slider_5)
Z_3 = UnitZ(Factor=subtraction)
move_5 = Move(Geometry=[line_8, line_9], Motion=Z_3)  # -> Geometry, Transform
extr_2 = Extrude(Base=boundary_5, Direction=Z_2)
extr_3 = Extrude(Base=boundary_4, Direction=Z_2)
rotate_4 = Rotate(Geometry=curve_3, Angle=degrees(1.570796327), Plane=area.Centroid)  # -> Geometry, Transform
move_6 = Move(Geometry=circle_3, Motion=Z_2)  # -> Geometry, Transform
sdiff = SolidDifference(BrepsA=extr_2, BrepsB=extr_3)
neg = Negative(Value=number_slider_5)
boundary_6 = BoundarySurfaces(Edges=move_6.Geometry)
Z_4 = UnitZ(Factor=neg)
extr_4 = Extrude(Base=boundary_6, Direction=Z_4)
sdiff_2 = SolidDifference(BrepsA=sdiff, BrepsB=extr_4)
