# Grasshopper definition Week 5 - Spiral Base.ghx (Grasshopper 1.0.8)

vector_xyz = VectorXYZ(XComponent=0, YComponent=0, ZComponent=0)  # -> Vector, Length
unit_y = UnitY(Factor=1)
line_sdl = LineSDL(Start=vector_xyz.Vector, Direction=unit_y, Length=Slider(150, range=0..1000))
unit_x = UnitX(Factor=Slider(50, range=0..100))
divide_curve = DivideCurve(Curve=line_sdl, Count=Slider(100, range=0..100), Kinks=False)  # -> Points, Tangents, Parameters
negative = Negative(Value=unit_x)
move = Move(Geometry=divide_curve.Points, Motion=negative)  # -> Geometry, Transform
list_length = ListLength(List=move.Transform)
subtraction = Subtraction(A=list_length, B="1")
list_item = ListItem(List=move.Geometry, Index=0, Wrap=True)
range = Range(Domain=Domain(0, 1), Steps=subtraction)
graph_mapper = GraphMapper(
    range,
    x0=0,
    x1=1,
    y0=0,
    y1=1,
    A=1,
    B=0,
    container_name="Linear",
    Graph_x0=0.25,
    Graph_x1=0.75,
    Graph_y0=0.25,
    Graph_y1=0.75)
construct_domain = ConstructDomain(DomainStart="1", DomainEnd=Slider(1, range=0..10))
bounds = Bounds(Numbers=graph_mapper)
remap_numbers = RemapNumbers(Value=graph_mapper, Source=bounds, Target=construct_domain)  # -> Mapped, Clipped
scale = Scale(Geometry=move.Geometry, Center=list_item, Factor=remap_numbers.Mapped)  # -> Geometry, Transform
list_length_2 = ListLength(List=scale.Geometry)
subtraction_2 = Subtraction(A=list_length_2, B="1")
range_2 = Range(Domain=Domain(0, 1), Steps=subtraction_2)
pi = Pi(Factor=1)
graph_mapper_2 = GraphMapper(
    range_2,
    x0=0,
    x1=1,
    y0=0,
    y1=1,
    A=1,
    B=0,
    container_name="Linear",
    Graph_x0=0.25,
    Graph_x1=0.75,
    Graph_y0=0.25,
    Graph_y1=0.75)
multiplication = Multiplication(A=pi, B=Slider(8.23, range=0..30))
construct_domain_2 = ConstructDomain(DomainStart=0, DomainEnd=multiplication)
bounds_2 = Bounds(Numbers=graph_mapper_2)
remap_numbers_2 = RemapNumbers(Value=graph_mapper_2, Source=bounds_2, Target=construct_domain_2)  # -> Mapped, Clipped
rotate = Rotate(Geometry=scale.Geometry, Angle=remap_numbers_2.Mapped, Plane=PlaneXY(0, 0, 0))  # -> Geometry, Transform
interpolate = Interpolate(Vertices=rotate.Geometry, Degree=3, Periodic=False, KnotStyle=1)  # -> Curve, Length, Domain
point_list = PointList(Points=rotate.Geometry, Size=Slider(8, range=0..100))
pipe = Pipe(Curve=interpolate.Curve, Radius=Slider(8, range=0..100), Caps=0)
unit_z = UnitZ(Factor=Slider(35, range=0..100))
extrude = Extrude(Base=interpolate.Curve, Direction=unit_z)
offset_curve = OffsetCurve(Curve=interpolate.Curve, Distance=Slider(6, range=0..10), Corners=1)
divide_curve_2 = DivideCurve(Curve=offset_curve, Count=Slider(100, range=0..100), Kinks=False)  # -> Points, Tangents, Parameters
panel = Panel("""0
100""")
offset_surface = OffsetSurface(Surface=extrude, Distance=Slider(6, range=0..100), Retrim=True)
panel_2 = Panel("""0
100""")
brep = Brep(extrude)
brep_2 = Brep(offset_surface)
list_item_2 = ListItem(List=rotate.Geometry, Index=panel, Wrap=True)
point_list_2 = PointList(Points=divide_curve_2.Points, Size=Slider(8, range=0..100))
list_item_3 = ListItem(List=divide_curve_2.Points, Index=panel_2, Wrap=True)
unit_z_2 = UnitZ(Factor=Slider(0, range=0..100))
loft = Loft(Curves=[brep, brep_2], Options={Adjust=False, Closed=False, LoftEnds=0, LoftSimp=0, LoftType=0, Rebuild=10, Refit=0.01})
line = Line(StartPoint=list_item_2, EndPoint=list_item_3)
move_2 = Move(Geometry=loft, Motion=unit_z_2)  # -> Geometry, Transform
merge = Merge(Data1=flatten(line), Data3=flatten(rotate.Geometry))
boundary_surfaces = BoundarySurfaces(Edges=merge)
